# Grasshopper definition 3d.gh (Grasshopper 1.0.8)
# plug-ins: ComfyGH Info

panel = Panel("A chair in the shape of a seashell, Gaudi, white background")
comfy = Comfy(URL="http://57.180.133.176", Workflow="D:\Users\akiak\Desktop\sdxl2tripo_turbo.json", Prompt=panel)  # -> Output, Image, Mesh
mesh = Mesh(comfy.Mesh)
ci = ComfyImage(comfy.Image)
